# Grasshopper definition 200713_4DPrinting_ProgTex_Ronny_Haberer_Core.gh (Grasshopper 0.9.76)
# plug-ins: ClipperComponents, Weaverbird, Kangaroo2 Components

# ---- group: start with 1000 iterations for the solver / Settings
meshsize_maschung = ValueList({"Rough (1.4)": 1.4, "Rough (1.3)": 1.3, "Medium (1.0)": 1.0, "Fine (0.75)": 0.75, "Fine (0.5)": 0.5}, selected="Rough (1.3)")
show_3d_print_deformation = BooleanToggle(True)
example = ValueList({"Circle": 0, "Box": 1, "Star": 2, "Pattern": 3, "Origami": 4}, selected="Circle")
stretching = ValueList({"120%": 0.83, "130%": 0.77, "150%": 0.66}, selected="150%")
iterations = Panel("1000")

# ----
select = Select(i=example)

# ---- group: 3d print
crv = Geometry(select)

# ----
center = Center(crv=crv)
divide_curves = DivideCurves(I=center)  # -> crv_2, pt_2, valancy_2

# ---- group: generate textile and integrate 3d print
crv_2 = Curve(divide_curves.crv_2)
list = ValueList({"1", "1.5", "2", "3", "4"}, selected="1.5")
polyoffset = PolylineOffset(
    Polylines=flatten(crv_2),
    Distance=list,
    Plane=Plane(origin=(0, 0, 0), x=(0, 0, 0), y=(0, 0, 0)),
    Tolerance=0.01,
    ClosedFillet=1,
    OpenFillet=1,
    Miter=2)  # -> Contour, Holes
integrate_print = IntegratePrint(geo_2=polyoffset.Contour, meshsize=meshsize_maschung, geo=flatten(crv_2))
wbedges = WeaverbirdsMeshEdges(MeshOrPolylines=integrate_print)
separation = Separation(C=wbedges, T=divide_curves.crv_2)

# ---- group: Solver
define_goals = DefineGoals(
    wbedges=wbedges,
    pt=divide_curves.pt_2,
    int=divide_curves.valancy_2,
    printlines=separation,
    B=stretching,
    mesh=integrate_print)
zombiesolver = ZombieSolver(GoalObjects=define_goals, Threshold=1e-08, Tolerance=0.0001, MaxIterations=iterations)  # -> I, V, O

# ---- group: Result / nevermind the error
mesh = Mesh(zombiesolver.O)

# ---- group: Result
result = Result(mesh=mesh, print=separation, x=show_3d_print_deformation)  # -> flatten(result_2)

# ==== cluster DivideCurves
I = ClusterInput()
null = NullItem(Item=I)  # -> NullFlags, InvalidFlags, Description
dispatch = Dispatch(List=I, DispatchPattern=null.NullFlags)  # -> ListA, ListB
geo = Geometry(dispatch.ListB)

# ---- group: handles curves with no intersections
lng = ListLength(List=geo)
series = Series(Start=0, Step=1, Count=lng)
round = Round(Number=series)  # -> Nearest, Floor, Ceiling

# ---- group: solve intersections
mcx = MultipleCurves(Curves=geo)  # -> Points, IndexA, IndexB, ParamA, ParamB
equals = Equality(FirstNumber=mcx.IndexA, SecondNumber=graft(series))  # -> Equality, Inequality
equals_2 = Equality(FirstNumber=mcx.IndexB, SecondNumber=graft(series))  # -> Equality, Inequality
dispatch_2 = Dispatch(List=mcx.ParamB, DispatchPattern=equals_2.Equality)  # -> ListA, ListB
dispatch_3 = Dispatch(List=mcx.ParamA, DispatchPattern=equals.Equality)  # -> ListA, ListB
merge = Merge(Data1=dispatch_3.ListA, Data2=dispatch_2.ListA)
shatter = Shatter(Curve=graft(geo), Parameters=merge)  # -> simplify(Segments)

# ---- group: handles curves with no intersections (continued)
sunion = SetUnion(SetA=mcx.IndexA, SetB=mcx.IndexB)
exdiff = SetDifferenceS(SetA=round.Nearest, SetB=sunion)
item = ListItem(List=geo, Index=exdiff, Wrap=True)  # -> graft(Item)
branch = TreeBranch(Tree=shatter, Path=graft(exdiff), MaintainPaths=True)
match = MatchTree(Tree=item, Guide=branch)

# ----
merge_2 = Merge(Data1=match, Data2=shatter)  # -> flatten(Result)

# ---- group: intersection points & valency
end = EndPoints(Curve=merge_2)  # -> Start, End
cullpt = CullDuplicates(Points=flatten([end.Start, end.End]), Tolerance=0.1, CullMode=3)  # -> Points, Indices, Valence
smaller = SmallerThan(FirstNumber=cullpt.Valence, SecondNumber=3)  # -> SmallerThan, OrEqualTo
dispatch_4 = Dispatch(List=cullpt.Valence, DispatchPattern=smaller.SmallerThan)  # -> ListA, ListB
dispatch_5 = Dispatch(List=cullpt.Points, DispatchPattern=smaller.SmallerThan)  # -> ListA, ListB

# ----
pt = Point(simplify(flatten(dispatch_5.ListB)))
valancy = Integer(flatten(dispatch_4.ListB))
crv = Curve(merge_2)
crv_2 = ClusterOutput(crv)
valancy_2 = ClusterOutput(valancy)
pt_2 = ClusterOutput(pt)

# ==== cluster IntegratePrint
geo = ClusterInput()
geo_2 = ClusterInput()
geo_3 = ClusterInput()
geo_4 = Geometry(geo)
geo_5 = Geometry(geo_3)
null = NullItem(Item=geo_4)  # -> NullFlags, InvalidFlags, Description
null_2 = NullItem(Item=geo_5)  # -> NullFlags, InvalidFlags, Description
circle = CircleCNR(Center=Point(1283, 814, 0), Normal=Vector(0, 0, 1), Radius=0.01)
item = ListItem(List=null.InvalidFlags, Index=0, Wrap=True)
circle_2 = CircleCNR(Center=Point(1547, 1475, 0), Normal=Vector(0, 0, 1), Radius=0.01)
item_2 = ListItem(List=null_2.InvalidFlags, Index=0, Wrap=True)
geo_6 = Geometry(geo_2)
filter = StreamFilter(Gate=item, Stream0=geo_4, Stream1=circle)
filter_2 = StreamFilter(Gate=item_2, Stream0=geo_5, Stream1=circle_2)
brep = Brep(geo_6)
lng = ListLength(List=filter)
ins = InsertItems(List=filter, Item=filter_2, Indices=lng, Wrap=True)
explode = Explode(Curve=ins, Recursive=True)  # -> flatten(Segments), Vertices
meshsize = ClusterInput()
discretization = Discretization(
    Breps=brep,
    Curves=explode.Segments,
    Tolerance=0.001,
    MeshSize=meshsize,
    Iterations=Slider(500, range=0..10000),
    Beta=Slider(0.7, range=0.1..3))  # -> Meshes, Curves
demesh = DeconstructMesh(Mesh=discretization.Meshes)  # -> Vertices, Faces, Colours, Normals
incurves = PointInCurves(Point=demesh.Vertices, Curves=filter_2)  # -> Relationship, Index, Point
larger = LargerThan(FirstNumber=incurves.Relationship, SecondNumber=1)  # -> LargerThan, OrEqualTo
cullv = CullVertices(Mesh=discretization.Meshes, Pattern=larger.LargerThan, Shrink=True)
add_imperfection = AddImperfection(M=cullv)
M = ClusterOutput(add_imperfection)

# ==== cluster Separation
C = ClusterInput()
T = ClusterInput()

# ---- group: separate print and textile
end = EndPoints(Curve=C)  # -> Start, End
pdecon = Deconstruct(Point=end.Start)  # -> XComponent, YComponent, ZComponent
pdecon_2 = Deconstruct(Point=end.End)  # -> XComponent, YComponent, ZComponent
pt = ConstructPoint(XCoordinate=pdecon.XComponent, YCoordinate=pdecon.YComponent, ZCoordinate=0)
pt_2 = ConstructPoint(XCoordinate=pdecon_2.XComponent, YCoordinate=pdecon_2.YComponent, ZCoordinate=0)
ln = Line(StartPoint=pt, EndPoint=pt_2)
flatten = FlattenTree(Tree=T, Path="{0}")  # -> simplify(graft(Tree))
curvepoint = PointOnCurve(ln, parameter=0.5)
crv_cp = CurveClosestPoint(Point=curvepoint, Curve=flatten)  # -> Point, Parameter, simplify(Distance)
sort = SortList(Keys=crv_cp.Distance)  # -> Keys, ValuesA
number_slider = Slider(1, range=0..10)
item = ListItem(List=sort.Keys, Index=0, Wrap=True)
number_slider_2 = Slider(120, range=0..2000)
eval = Evaluate(F="If(x<0.05, 0.05, x)", x=item)
addition = Addition(A=crv_cp.Distance, B=number_slider)

# ----
multiplication = Multiplication(A=eval, B=number_slider_2)  # -> simplify(Result)

# ---- group: separate print and textile (continued)
similar = Similarity(FirstNumber=simplify(addition), SecondNumber=number_slider, Threshold=simplify(multiplication))  # -> Similarity, AbsoluteDifference

# ----
similarity = ClusterOutput(similar.Similarity)

# ==== cluster Result
mesh = ClusterInput()
clean = CleanTree(RemoveNulls=True, RemoveInvalid=True, RemoveEmpty=False, Tree=mesh)

# ---- group: pipes
radius = Slider(0.3, range=0..1)
print = ClusterInput()
x = ClusterInput()
wbedges = WeaverbirdsMeshEdges(MeshOrPolylines=clean)
dispatch = Dispatch(List=wbedges, DispatchPattern=print)  # -> ListA, flatten(ListB)
expression = Expression(x=x, y=radius, Expression="If(x, y, 0)")
lng = ListLength(List=dispatch.ListA)
join = JoinCurves(Curves=dispatch.ListA, Preserve=False)
addition = Addition(A=lng, B=1)
reb = RebuildCurve(Curve=simplify(flatten(join)), Degree=3, Count=simplify(flatten(addition)), Tangents=True)
pipe = Pipe(Curve=reb, Radius=expression, Caps=2)  # -> flatten(Pipe)
mjoin = MeshJoin(Meshes=pipe)
clean_2 = CleanTree(RemoveNulls=True, RemoveInvalid=True, RemoveEmpty=False, Tree=mjoin)

# ---- group: textile
wbloop = WeaverbirdsLoopSubdivision(MeshCurves=clean, Level=2, SmoothNakedEdges=0)  # -> flatten(OutputMeshCurves)

# ----
merge = Merge(Data1=wbloop, Data2=clean_2)
result = Mesh(merge)
result_2 = ClusterOutput(result)

# ==== cluster DefineGoals
printlines = ClusterInput()
wbedges = ClusterInput()
gate = StreamGate(Printlines=printlines, Gate=0)  # -> Target0, Target1
wbedges_2 = Line(wbedges)
dispatch = Dispatch(List=wbedges_2, DispatchPattern=gate.Target0)  # -> ListA, ListB
join = JoinCurves(Curves=simplify(dispatch.ListA), Preserve=False)
explode = Explode(Curve=join, Recursive=True)  # -> Segments, Vertices
int = ClusterInput()
pt = ClusterInput()
number_slider = Slider(7, range=0..10)

# ---- group: knots
int_2 = Integer(int)
pt_2 = Point(pt)
flatten = FlattenTree(Tree=explode.Segments, Path="{0}")
curvepoint = PointOnCurve(flatten, parameter=0.5)
cps = ClosestPoints(Point=pt_2, Cloud=curvepoint, Count=int_2)  # -> ClosestPoint, CPIndex, Distance
item = ListItem(List=flatten, Index=cps.CPIndex, Wrap=True)
line = Line(item)
lng = ListLength(List=line)
series = Series(Start=0, Step=1, Count=expr("x-1", lng))
line_2 = Line(line)
shift = ShiftList(List=line, Shift=series, Wrap=True)
angle = Angle(LineA=line_2, LineB=shift, Strength=number_slider)
length_line = LengthLine(Line=line_2, Strength=number_slider)

# ----
number_slider_2 = Slider(10, range=0..10)

# ---- group: segments
cls = Closed(Curve=join)  # -> Closed, Periodic
line_3 = Line(explode.Segments)
shift_2 = ShiftList(List=simplify(line_3), Shift=1, Wrap=simplify(cls.Closed))
line_4 = Line(line_3)
short = ShortestList(ListA=line_4, ListB=shift_2, TrimMode=2)  # -> ListA, ListB
angle_2 = Angle(LineA=short.ListA, LineB=short.ListB, Strength=number_slider_2)
length_line_2 = LengthLine(Line=line_4, Strength=number_slider_2)

# ----
B = ClusterInput()
mesh = ClusterInput()

mesh_2 = Mesh(mesh)
smooth = Smooth(M=mesh_2, Strength=Slider(2, range=0..10))
show = Show(G=mesh_2)

# ---- group: textile
flip = FlipMatrix(Data=gate.Target0)
cset = CreateSet(List=flip)  # -> Set, Map
lng_2 = ListLength(List=cset.Set)
larger = LargerThan(FirstNumber=lng_2, SecondNumber=1)  # -> flatten(LargerThan), OrEqualTo
dispatch_2 = Dispatch(List=wbedges_2, DispatchPattern=larger.LargerThan)  # -> ListA, flatten(ListB)
line_5 = Line(dispatch_2.ListB)
len = Length(Curve=line_5)

# ----
multiplication = Multiplication(A=len, B=B)

# ---- group: textile (continued)
length_line_3 = LengthLine(Line=line_5, Length=multiplication, Strength=Slider(1, range=1..10))

# ----
goal_objects = Merge(Data1=length_line_2, Data2=angle_2, Data3=length_line, Data4=angle, Data5=length_line_3, Data6=show, Data7=smooth)  # -> flatten(Result)
clean = CleanTree(RemoveNulls=True, RemoveInvalid=True, RemoveEmpty=False, Tree=goal_objects)
T = ClusterOutput(clean)

# ==== cluster Select
number_slider = Slider(7, range=0..10)
multiplication = Multiplication(A=number_slider, B=2)
Z = UnitZ(Factor=1)
vec = VectorXYZ(XComponent=multiplication, YComponent=multiplication, ZComponent=0)  # -> Vector, Length
number_slider_2 = Slider(3, range=0..10)
circle = CircleCNR(Center=Z, Normal=Z, Radius=number_slider)
Z_2 = UnitZ(Factor=0)
rec_2pt = Rectangle2Pt(Plane=PlaneXY(0, 0, 0), PointA=Point(0, 0, 0), PointB=vec.Vector, Radius=0)  # -> Rectangle, Length
ln = Line(StartPoint=Z_2, EndPoint=vec.Vector)
multiplication_2 = Multiplication(A=number_slider_2, B=2)
arrpolar = PolarArray(Geometry=ln, Plane=PlaneXY(0, 0, 0), Count=multiplication_2, Angle=6.283185307)  # -> Geometry, Transform
arrrec = RectangularArray(Geometry=circle, Cell=rec_2pt.Rectangle, XCount=3, YCount=3)  # -> Geometry, Transform
division = Division(A=1, B=number_slider_2)
join = JoinCurves(Curves=arrpolar.Geometry, Preserve=False)
end = EndPoints(Curve=join)  # -> Start, End
multiplication_3 = Multiplication(A=division, B=3.141592654)
ln_2 = Line(StartPoint=Z_2, EndPoint=Z)
ln_3 = Line(StartPoint=end.Start, EndPoint=end.End)
rotax = RotateAxis(Geometry=ln_3, Angle=multiplication_3, Axis=ln_2)  # -> Geometry, Transform
join_2 = JoinCurves(Curves=[join, ln_3, rotax.Geometry], Preserve=False)
origami = Curve([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])
pattern = Curve([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])
rectangle = Curve(rec_2pt.Rectangle)
circle_2 = Curve(circle)
star = Curve(join_2)
grp = Group(Objects=rectangle)
grp_2 = Group(Objects=star)
grp_3 = Group(Objects=pattern)
grp_4 = Group(Objects=origami)
grp_5 = Group(Objects=circle_2)
merge = Merge(Data1=flatten(grp_5), Data2=flatten(grp), Data3=flatten(grp_2), Data4=flatten(grp_3), Data5=flatten(grp_4))
i = ClusterInput()
item = ListItem(List=merge, Index=i, Wrap=True)
ungroup = Ungroup(Group=item)
crv = Curve(flatten(ungroup))
crv_2 = ClusterOutput(crv)

# ==== cluster Center
crv = ClusterInput()
crv_2 = Curve(crv)
cpoly = ControlPolygon(Curve=crv_2)  # -> Polygon, Points
pcen = PolygonCenter(Polyline=cpoly.Polygon)  # -> CenterV, CenterE, CenterA
ma = MassAddition(Input=pcen.CenterV)  # -> Result, PartialResults
lng = ListLength(List=pcen.CenterV)
division = Division(A=ma.Result, B=lng)
gruppenmittelpunkt = Point(division)
center = Point(Point(0, 0, 0))
vec2pt = Vector2Pt(PointA=gruppenmittelpunkt, PointB=center, Unitize=False)  # -> Vector, Length
move = Move(Geometry=crv_2, Motion=vec2pt.Vector)  # -> Geometry, Transform
C = ClusterOutput(move.Geometry)

# ==== cluster AddImperfection
M = ClusterInput()
cullvertices = MeshCullUnusedVertices(Mesh=M)
demesh = DeconstructMesh(Mesh=cullvertices)  # -> Vertices, Faces, Colours, Normals
null = NullItem(Item=demesh.Vertices)  # -> NullFlags, InvalidFlags, Description
not = GateNot(A=null.InvalidFlags)
cull = CullPattern(List=demesh.Vertices, CullPattern=not)
pdecon = Deconstruct(Point=cull)  # -> XComponent, YComponent, ZComponent
lng = ListLength(List=pdecon.ZComponent)
random = Random(Range=Domain(0, 0.001), Number=lng, Seed=2)
pt = ConstructPoint(XCoordinate=pdecon.XComponent, YCoordinate=pdecon.YComponent, ZCoordinate=random)
conmesh = ConstructMesh(Vertices=pt, Faces=demesh.Faces)
M_2 = ClusterOutput(conmesh)
