# Grasshopper definition 200710_4DPrinting_ProgTex_Ronny_Haberer.gh (Grasshopper 0.9.76)
# plug-ins: Human UI, ClipperComponents, Anemone, Weaverbird, Kangaroo2 Components

getscreen = GetScreenDimensions()  # -> Width, Height
swatch = Red(SwatchColor=RGB(255, 255, 255))
swatch_2 = Red(SwatchColor=RGB(150, 150, 150))
accent = ValueList({"Amber", "Blue", "Brown", "Cobalt", "Crimson", "Cyan", "Emerald", "Green", "Indigo", "Lime", "Magenta", "Mauve", "Olive", "Orange", "Pink", "Purple", "Red", "Sienna", "Steel", "Taupe", "Teal", "Violet", "Yellow"}, selected="Blue")
checkbox = CreateCheckbox(Label="Use Examples", StartingValue=True)
colorpicker = CreateColorPicker(DefaultColor=swatch)
colorpicker_2 = CreateColorPicker(DefaultColor=swatch_2)
checkbox_2 = CreateCheckbox(Label="3D View", StartingValue=True)
checkbox_3 = CreateCheckbox(Label="Export", StartingValue=False)
textbox = CreateTextBox(DefaultText="Input Layer", UpdateButton=False, showLabel=True)
radiobtn = CreateRadioButton(RadioButtonName="Circle", RadioButtonGroup="Use Examples", InitiallySelected=True)
radiobtn_2 = CreateRadioButton(RadioButtonName="Rectangle", RadioButtonGroup="Use Examples", InitiallySelected=False)
radiobtn_3 = CreateRadioButton(RadioButtonName="Star", RadioButtonGroup="Use Examples", InitiallySelected=False)
radiobtn_4 = CreateRadioButton(RadioButtonName="Pattern", RadioButtonGroup="Use Examples", InitiallySelected=False)
radiobtn_5 = CreateRadioButton(RadioButtonName="Origami", RadioButtonGroup="Use Examples", InitiallySelected=False)
tb = CreateTextBlock(Text="Colour", TextSize=12, Justification=0)
checkbox_4 = CreateCheckbox(Label="Rendering", StartingValue=False)
checkbox_5 = CreateCheckbox(Label="Stepper", StartingValue=True)
checkbox_6 = CreateCheckbox(Label="Pipes", StartingValue=True)
tb_2 = CreateTextBlock(Text="Resolution", TextSize=12, Justification=0)
radiobtn_6 = CreateRadioButton(RadioButtonName="Max", RadioButtonGroup="Resolution", InitiallySelected=False)
radiobtn_7 = CreateRadioButton(RadioButtonName="High", RadioButtonGroup="Resolution", InitiallySelected=False)
radiobtn_8 = CreateRadioButton(RadioButtonName="Medium", RadioButtonGroup="Resolution", InitiallySelected=True)
radiobtn_9 = CreateRadioButton(RadioButtonName="Low", RadioButtonGroup="Resolution", InitiallySelected=False)
radiobtn_10 = CreateRadioButton(RadioButtonName="Min", RadioButtonGroup="Resolution", InitiallySelected=False)
swatch_3 = White(SwatchColor=RGB(57, 68, 76))
pt = Point(Point(0, 0, 0))
adjustpos = AdjustElementPositioning(
    ElementsToAdjust=[colorpicker_2, checkbox_6, colorpicker, textbox, checkbox_5, tb, checkbox_2, checkbox_4, checkbox_3],
    Margin="0,0,0,10",
    AbsolutePositioning=False)
adjustpos_2 = AdjustElementPositioning(ElementsToAdjust=textbox, Margin="0,5,0,5", AbsolutePositioning=False)
adjustpos_3 = AdjustElementPositioning(ElementsToAdjust=checkbox, Margin="0,5,0,10", AbsolutePositioning=False)
adjustpos_4 = AdjustElementPositioning(ElementsToAdjust=tb, Margin="0,0,0,5", AbsolutePositioning=False)
adjustpos_5 = AdjustElementPositioning(ElementsToAdjust=tb_2, Margin="0,0,0,5", AbsolutePositioning=False)
merge = Merge(Data1=textbox, Data2=checkbox, Data3=radiobtn, Data4=radiobtn_2, Data5=radiobtn_3, Data6=radiobtn_4, Data7=radiobtn_5)
merge_2 = Merge(Data1=radiobtn, Data2=radiobtn_2, Data3=radiobtn_3, Data4=radiobtn_4, Data5=radiobtn_5)
merge_3 = Merge(
    Data1=tb,
    Data2=textbox,
    Data3=colorpicker,
    Data4=colorpicker_2,
    Data5=checkbox_2,
    Data6=checkbox_4,
    Data7=checkbox_3,
    Data8=checkbox_5,
    Data9=checkbox_6,
    Data10=tb_2,
    Data11=radiobtn_6,
    Data12=radiobtn_7,
    Data13=radiobtn_8,
    Data14=radiobtn_9,
    Data15=radiobtn_10)
merge_4 = Merge(Data1=radiobtn_6, Data2=radiobtn_7, Data3=radiobtn_8, Data4=radiobtn_9, Data5=radiobtn_10)
msphere = MeshSphereEx(Base=PlaneXY(0, 0, 0), Radius=1e-06, Count=1)
stack = CreateStack(UIElements=merge, Horizontal=False)
stack_2 = CreateStack(UIElements=merge_3, Horizontal=False)
toggle = CreateToggle(Default=False, OnLabel="Start", OffLabel="Stop")
_3dview = Create3DView(MeshToDisplay=msphere, MeshColors=swatch_3, ViewWidth=getscreen.Width, ViewHeight=getscreen.Height)
button = CreateButton(ButtonName="Reset", ButtonStyle=0)
button_2 = CreateButton(ButtonName="Start / Stop", ButtonStyle=0)
button_3 = CreateButton(ButtonName="Bake", ButtonStyle=0)
expander = CreateExpander(UIElements=stack, Header="  Input", Open=False)
expander_2 = CreateExpander(UIElements=stack_2, Header="  Settings", Open=False)
adjustpos_6 = AdjustElementPositioning(ElementsToAdjust=stack, AbsolutePositioning=False, Width=100, HorizontalAlignment=3, VerticalAlignment=3)
adjustpos_7 = AdjustElementPositioning(ElementsToAdjust=stack_2, AbsolutePositioning=False, Width=100, HorizontalAlignment=3, VerticalAlignment=3)
tooltip = AttachTooltipToElement(ElementsToAttachTo=button, TooltipContent="Reset the Simulation", ShowDelay=500, Duration=2000)
tooltip_2 = AttachTooltipToElement(ElementsToAttachTo=button_2, TooltipContent="Hold to Start the Simulation", ShowDelay=500, Duration=2000)
tooltip_3 = AttachTooltipToElement(ElementsToAttachTo=expander, TooltipContent="What to Simulate?", ShowDelay=500, Duration=2000)
adjustpos_8 = AdjustElementPositioning(ElementsToAdjust=[expander_2, expander], Margin="0,10,0,0", AbsolutePositioning=False)
merge_5 = Merge(Data1=button, Data2=toggle, Data3=button_2, Data4=button_3, Data5=expander, Data6=expander_2)
merge_6 = Merge(Data1=toggle, Data2=button, Data3=button_2, Data4=button_3, Data5=expander, Data6=expander_2)
adjustpos_9 = AdjustElementPositioning(
    ElementsToAdjust=merge_5,
    Margin="0,5,0,5",
    AbsolutePositioning=False,
    Width=120,
    HorizontalAlignment=3,
    VerticalAlignment=2)
stack_3 = CreateStack(UIElements=merge_5, Horizontal=False)
merge_7 = Merge(Data1=stack_3, Data2=_3dview)
adjustpos_10 = AdjustElementPositioning(ElementsToAdjust=stack_3, Margin="0", AbsolutePositioning=False, Width=150, HorizontalAlignment=3, VerticalAlignment=2)
stack_4 = CreateStack(UIElements=merge_7, Horizontal=True)
val = ValueListener(Elements=toggle, SomeProperty=True)  # -> StartToogle, Indices
val_2 = ValueListener(Elements=button, SomeProperty=True)  # -> Values, Indices
val_3 = ValueListener(Elements=button_2, SomeProperty=True)  # -> StartStop, Indices
val_4 = ValueListener(Elements=button_3, SomeProperty=True)  # -> Values, Indices
val_5 = ValueListener(Elements=textbox, SomeProperty=True)  # -> Values, Indices
val_6 = ValueListener(Elements=checkbox, SomeProperty=True)  # -> flatten(Example), Indices
val_7 = ValueListener(Elements=merge_2, SomeProperty=True)  # -> flatten(Values), Indices
val_8 = ValueListener(Elements=colorpicker, SomeProperty=True)  # -> Color1, Indices
val_9 = ValueListener(Elements=colorpicker_2, SomeProperty=True)  # -> Color2, Indices
val_10 = ValueListener(Elements=checkbox_2, SomeProperty=True)  # -> _3DView, Indices
expression = Expression(x=val_10._3DView, y=getscreen.Width, Expression="If( x, y, 152)")
hideshow = HideShowElement(ElementToHideShow=_3dview, Show=val_10._3DView, Collapse=False, Disable=False)
val_11 = ValueListener(Elements=checkbox_3, SomeProperty=True)  # -> Values, Indices
val_12 = ValueListener(Elements=checkbox_4, SomeProperty=True)  # -> Rendering, Indices
val_13 = ValueListener(Elements=checkbox_5, SomeProperty=True)  # -> Stepper, Indices
val_14 = ValueListener(Elements=checkbox_6, SomeProperty=True)  # -> Values, Indices
val_15 = ValueListener(Elements=merge_4, SomeProperty=True)  # -> flatten(Values), Indices
viewbox = CreateViewBox(UIElements=stack_4, Width=expr("x-50", getscreen.Width), Height=expr("x-50", getscreen.Height))
merge_8 = Merge(Data1=val_8.Color1, Data2=val_9.Color2)
or = GateOr(A=val.StartToogle, B=val_3.StartStop)
and = GateAnd(A=or, B=val_12.Rendering)
select = Select(layer=val_5.Values, example=val_6.Example, nr=val_7.Values)

# ---- group: Show UI
toggle_2 = BooleanToggle(True)

# ----
launchwin = LaunchWindow(
    Show=toggle_2,
    Name="4D Printing Simulation",
    Width=expression,
    Height=getscreen.Height,
    FontFamily="Minion Pro",
    ChildStatus=0,
    EnableHorizScroll=False)
winprops = SetWindowProperties(
    Window=launchwin,
    StartingLocation=pt,
    Theme=Toggle(True),
    AccentColor=accent,
    ShowTitleBar=Toggle(True),
    BackgroundColor=swatch_3,
    ScaleFactor=1)
addelems = AddElements(Window=launchwin, Elements=viewbox, DoVLChecking=True)  # -> AddedElements, ElementNames

# ---- group: 3d print
crv = Geometry(select)

# ----
center = Center(crv=crv)
divide_curves = DivideCurves(I=center)  # -> crv_2, pt_2, valancy_2

# ---- group: generate textile and integrate 3d print
crv_2 = Curve(divide_curves.crv_2)
list = ValueList({"1", "1.5", "2", "3", "4"}, selected="1.5")
polyoffset = PolylineOffset(
    Polylines=flatten(crv_2),
    Distance=list,
    Plane=Plane(origin=(0, 0, 0), x=(0, 0, 0), y=(0, 0, 0)),
    Tolerance=0.01,
    ClosedFillet=1,
    OpenFillet=1,
    Miter=2)  # -> Contour, Holes
integrate_print = IntegratePrint(geo_2=polyoffset.Contour, geo=flatten(crv_2), mesh_size=val_15.Values)

# ----
trigger = Boolean(or)
loop_start = LoopStart(Repeat=20, Trigger=trigger, Data=1)  # -> port, Counter, Data
not = GateNot(A=trigger)
wbedges = WeaverbirdsMeshEdges(MeshOrPolylines=integrate_print)
multiplication = Multiplication(A=loop_start.Data, B=1.1)
loop_end = LoopEnd(port=loop_start.port, Exit=not, Data=multiplication, pausedState=False, state="Constant output", TimeOutVal=0)
separation = Separation(C=wbedges, T=divide_curves.crv_2)
stretching = ValueList({"120%": 0.83, "130%": 0.77, "150%": 0.66}, selected="150%")
steps = Steps(num=loop_end, stepper=val_13.Stepper)
define_goals = DefineGoals(
    wbedges=wbedges,
    pt=divide_curves.pt_2,
    int=divide_curves.valancy_2,
    printlines=separation,
    B=stretching,
    mesh=integrate_print)
bouncysolver = BouncySolver(GoalObjects=define_goals, Reset=val_2.Values, Threshold=1e-08, Tolerance=0.0001, Damping=0.99, Iterations=steps, On=or)  # -> I, V, O
iterations = Panel(bouncysolver.I)
mesh = Mesh(bouncysolver.O)
result = Result(mesh=mesh, print=separation, x=val_14.Values)  # -> flatten(result_2)
ende = Panel("1000")
set3dview = Set3DView(_3DView=_3dview, MeshToDisplay=result, MeshColors=merge_8)
output = Output(in_run=val_11.Values, O=result, B=val_4.Values, N=bouncysolver.I)
render = Render(result=result, iteration=bouncysolver.I, ende=ende, render=and)

# ==== cluster DivideCurves
I = ClusterInput()
null = NullItem(Item=I)  # -> NullFlags, InvalidFlags, Description
dispatch = Dispatch(List=I, DispatchPattern=null.NullFlags)  # -> ListA, ListB
geo = Geometry(dispatch.ListB)

# ---- group: handles curves with no intersections
lng = ListLength(List=geo)
series = Series(Start=0, Step=1, Count=lng)
round = Round(Number=series)  # -> Nearest, Floor, Ceiling

# ---- group: solve intersections
mcx = MultipleCurves(Curves=geo)  # -> Points, IndexA, IndexB, ParamA, ParamB
equals = Equality(FirstNumber=mcx.IndexA, SecondNumber=graft(series))  # -> Equality, Inequality
equals_2 = Equality(FirstNumber=mcx.IndexB, SecondNumber=graft(series))  # -> Equality, Inequality
dispatch_2 = Dispatch(List=mcx.ParamB, DispatchPattern=equals_2.Equality)  # -> ListA, ListB
dispatch_3 = Dispatch(List=mcx.ParamA, DispatchPattern=equals.Equality)  # -> ListA, ListB
merge = Merge(Data1=dispatch_3.ListA, Data2=dispatch_2.ListA)
shatter = Shatter(Curve=graft(geo), Parameters=merge)  # -> simplify(Segments)

# ---- group: handles curves with no intersections (continued)
sunion = SetUnion(SetA=mcx.IndexA, SetB=mcx.IndexB)
exdiff = SetDifferenceS(SetA=round.Nearest, SetB=sunion)
item = ListItem(List=geo, Index=exdiff, Wrap=True)  # -> graft(Item)
branch = TreeBranch(Tree=shatter, Path=graft(exdiff), MaintainPaths=True)
match = MatchTree(Tree=item, Guide=branch)

# ----
merge_2 = Merge(Data1=match, Data2=shatter)  # -> flatten(Result)

# ---- group: intersection points & valency
end = EndPoints(Curve=merge_2)  # -> Start, End
cullpt = CullDuplicates(Points=flatten([end.Start, end.End]), Tolerance=0.1, CullMode=3)  # -> Points, Indices, Valence
smaller = SmallerThan(FirstNumber=cullpt.Valence, SecondNumber=3)  # -> SmallerThan, OrEqualTo
dispatch_4 = Dispatch(List=cullpt.Valence, DispatchPattern=smaller.SmallerThan)  # -> ListA, ListB
dispatch_5 = Dispatch(List=cullpt.Points, DispatchPattern=smaller.SmallerThan)  # -> ListA, ListB

# ----
pt = Point(simplify(flatten(dispatch_5.ListB)))
valancy = Integer(flatten(dispatch_4.ListB))
crv = Curve(merge_2)
crv_2 = ClusterOutput(crv)
valancy_2 = ClusterOutput(valancy)
pt_2 = ClusterOutput(pt)

# ==== cluster IntegratePrint
geo = ClusterInput()
geo_2 = ClusterInput()
geo_3 = ClusterInput()
mesh_size = ClusterInput()
pan = Panel("""0.5
0.75
1.0
1.3
1.4""")
geo_4 = Geometry(geo)
geo_5 = Geometry(geo_3)
dispatch = Dispatch(List=pan, DispatchPattern=mesh_size)  # -> ListA, ListB
null = NullItem(Item=geo_4)  # -> NullFlags, InvalidFlags, Description
null_2 = NullItem(Item=geo_5)  # -> NullFlags, InvalidFlags, Description
circle = CircleCNR(Center=Point(1283, 814, 0), Normal=Vector(0, 0, 1), Radius=0.01)
item = ListItem(List=null.InvalidFlags, Index=0, Wrap=True)
circle_2 = CircleCNR(Center=Point(1547, 1475, 0), Normal=Vector(0, 0, 1), Radius=0.01)
item_2 = ListItem(List=null_2.InvalidFlags, Index=0, Wrap=True)
geo_6 = Geometry(geo_2)
filter = StreamFilter(Gate=item, Stream0=geo_4, Stream1=circle)
filter_2 = StreamFilter(Gate=item_2, Stream0=geo_5, Stream1=circle_2)
brep = Brep(geo_6)
lng = ListLength(List=filter)
ins = InsertItems(List=filter, Item=filter_2, Indices=lng, Wrap=True)
explode = Explode(Curve=ins, Recursive=True)  # -> flatten(Segments), Vertices
discretization = Discretization(
    Breps=brep,
    Curves=explode.Segments,
    Tolerance=0.001,
    MeshSize=dispatch.ListA,
    Iterations=Slider(500, range=0..10000),
    Beta=Slider(0.7, range=0.1..3))  # -> Meshes, Curves
demesh = DeconstructMesh(Mesh=discretization.Meshes)  # -> Vertices, Faces, Colours, Normals
incurves = PointInCurves(Point=demesh.Vertices, Curves=filter_2)  # -> Relationship, Index, Point
larger = LargerThan(FirstNumber=incurves.Relationship, SecondNumber=1)  # -> LargerThan, OrEqualTo
cullv = CullVertices(Mesh=discretization.Meshes, Pattern=larger.LargerThan, Shrink=True)
add_imperfection = AddImperfection(M=cullv)
M = ClusterOutput(add_imperfection)

# ==== cluster Separation
C = ClusterInput()
T = ClusterInput()

# ---- group: separate print and textile
end = EndPoints(Curve=C)  # -> Start, End
pdecon = Deconstruct(Point=end.Start)  # -> XComponent, YComponent, ZComponent
pdecon_2 = Deconstruct(Point=end.End)  # -> XComponent, YComponent, ZComponent
pt = ConstructPoint(XCoordinate=pdecon.XComponent, YCoordinate=pdecon.YComponent, ZCoordinate=0)
pt_2 = ConstructPoint(XCoordinate=pdecon_2.XComponent, YCoordinate=pdecon_2.YComponent, ZCoordinate=0)
ln = Line(StartPoint=pt, EndPoint=pt_2)
flatten = FlattenTree(Tree=T, Path="{0}")  # -> simplify(graft(Tree))
curvepoint = PointOnCurve(ln, parameter=0.5)
crv_cp = CurveClosestPoint(Point=curvepoint, Curve=flatten)  # -> Point, Parameter, simplify(Distance)
sort = SortList(Keys=crv_cp.Distance)  # -> Keys, ValuesA
number_slider = Slider(1, range=0..10)
item = ListItem(List=sort.Keys, Index=0, Wrap=True)
number_slider_2 = Slider(120, range=0..2000)
eval = Evaluate(F="If(x<0.05, 0.05, x)", x=item)
addition = Addition(A=crv_cp.Distance, B=number_slider)

# ----
multiplication = Multiplication(A=eval, B=number_slider_2)  # -> simplify(Result)

# ---- group: separate print and textile (continued)
similar = Similarity(FirstNumber=simplify(addition), SecondNumber=number_slider, Threshold=simplify(multiplication))  # -> Similarity, AbsoluteDifference

# ----
similarity = ClusterOutput(similar.Similarity)

# ==== cluster Render
iteration = ClusterInput()
result = ClusterInput()
ende = ClusterInput()
result_2 = Mesh(flatten(result))
iteration_2 = Number(iteration)
ende_2 = Number(ende)
colour = ColourPicker(PickedColour=RGB(255, 255, 255))
colour_2 = ColourPicker(PickedColour=RGB(255, 255, 255))
colour_3 = ColourPicker(PickedColour=RGB(255, 255, 255))
colour_4 = ColourPicker(PickedColour=RGB(255, 255, 255))
division = Division(A=1, B=ende_2)
path = Panel("C:\Users\ronny\Desktop\render\")
expression = Expression(x=iteration_2, y=ende_2, Expression="If( x < y, true, false)")
material = CreateMaterial(
    Diffuse=colour,
    Specular=colour_3,
    Emission=RGB(0, 0, 0),
    Transparency=Slider(0, range=0..1),
    Shine=Slider(0, range=0..100))
material_2 = CreateMaterial(
    Diffuse=colour_2,
    Specular=colour_4,
    Emission=RGB(0, 0, 0),
    Transparency=Slider(0.1, range=0..1),
    Shine=Slider(0, range=0..100))
rotate = Rotate(Geometry=result_2, Angle=<missing>, Plane=PlaneXY(0, 0, 0))  # -> Geometry, Transform
render = ClusterInput()
merge = Merge(Data1=material, Data2=material_2)
and = GateAnd(A=expression, Render=render)
c_render_loop = CSharpScript(geometry=result_2, material=merge, activate=and, current=iteration_2, filePath=path)  # -> out; inputs geometry: list of GeometryBase, material: list, layers: list of String, activate: Boolean, current: Int32, filePath: String
# ---------- c_render_loop: C# ----------
    if(!activate) return;

    List<Guid> guids = new List<Guid>();

    for(int i = 0; i < geometry.Count; i++){

      Rhino.DocObjects.ObjectAttributes att = new Rhino.DocObjects.ObjectAttributes();

      Rhino.Display.DisplayMaterial shader = new Rhino.Display.DisplayMaterial();

      if(material.Count == geometry.Count){
        shader = (Rhino.Display.DisplayMaterial) material[i];
      }else if(material.Count > 0){
        shader = (Rhino.Display.DisplayMaterial) material[0];
      }

      Rhino.DocObjects.Material mat = new Rhino.DocObjects.Material();

      mat.AmbientColor = shader.Ambient;
      mat.DiffuseColor = shader.Diffuse;
      mat.EmissionColor = shader.Emission;
      mat.Shine = shader.Shine;
      mat.SpecularColor = shader.Specular;
      mat.Transparency = shader.Transparency;

      string shaderName = string.Format("D{0}-E{1}-S{2}-Sp{3}-T{4}",
        shader.Diffuse.Name,
        shader.Emission.Name,
        shader.Shine,
        shader.Specular,
        shader.Transparency
        );

      mat.Name = shaderName;

      int nwMat = doc.Materials.Find(shaderName, true);
      if(nwMat < 0) nwMat = doc.Materials.Add(mat);

      Print(nwMat.ToString());

      string layer = "";

      if(layers.Count == geometry.Count){
        layer = layers[i];
      }else if(layers.Count > 0){
        layer = layers[0];
      }

      if(layer.Length == 0){
        att.MaterialSource = Rhino.DocObjects.ObjectMaterialSource.MaterialFromObject;
        att.MaterialIndex = nwMat;
        att.LayerIndex = doc.Layers.Find(doc.Layers.CurrentLayer.Id, true);
      }else{
        att.MaterialSource = Rhino.DocObjects.ObjectMaterialSource.MaterialFromLayer;
        int layInd = doc.Layers.Find(layer, true);
        if(layInd < 0){
          Rhino.DocObjects.Layer l = new Rhino.DocObjects.Layer();
          l.Color = mat.DiffuseColor;
          l.Name = layer;
          l.RenderMaterialIndex = nwMat;
          layInd = doc.Layers.Add(l);
        }
        att.LayerIndex = layInd;
      }

      Guid id = Guid.Empty;

      if(geometry[i].ObjectType == Rhino.DocObjects.ObjectType.Brep) id = doc.Objects.AddBrep((Brep) geometry[i], att);
      if(geometry[i].ObjectType == Rhino.DocObjects.ObjectType.Surface) id = doc.Objects.AddSurface((Surface) geometry[i], att);
      if(geometry[i].ObjectType == Rhino.DocObjects.ObjectType.Mesh) id = doc.Objects.AddMesh((Mesh) geometry[i], att);

      if(id.ToString().Length > 0) guids.Add(id);

    }


    string savedLocation = filePath + "\\r" + current.ToString("") + ".png";

    Rhino.RhinoApp.RunScript("_-Render", false);
    Rhino.RhinoApp.RunScript("_-SaveRenderWindowAs \n\"" + savedLocation + "\"\n", false);
    Rhino.RhinoApp.RunScript("_-CloseRenderWindow", false);
    Rhino.RhinoApp.RunScript("_-ClearUndo", false);

    for(int i = 0; i < guids.Count; i++) doc.Objects.Delete(guids[i], true);
# ---------- end c_render_loop ----------

# ==== cluster Result
mesh = ClusterInput()
clean = CleanTree(RemoveNulls=True, RemoveInvalid=True, RemoveEmpty=False, Tree=mesh)

# ---- group: pipes
radius = Slider(0.3, range=0..1)
print = ClusterInput()
x = ClusterInput()
wbedges = WeaverbirdsMeshEdges(MeshOrPolylines=clean)
dispatch = Dispatch(List=wbedges, DispatchPattern=print)  # -> ListA, flatten(ListB)
expression = Expression(x=x, y=radius, Expression="If(x, y, 0)")
lng = ListLength(List=dispatch.ListA)
join = JoinCurves(Curves=dispatch.ListA, Preserve=False)
addition = Addition(A=lng, B=1)
reb = RebuildCurve(Curve=simplify(flatten(join)), Degree=3, Count=simplify(flatten(addition)), Tangents=True)
pipe = Pipe(Curve=reb, Radius=expression, Caps=2)  # -> flatten(Pipe)
mjoin = MeshJoin(Meshes=pipe)
clean_2 = CleanTree(RemoveNulls=True, RemoveInvalid=True, RemoveEmpty=False, Tree=mjoin)

# ---- group: textile
wbloop = WeaverbirdsLoopSubdivision(MeshCurves=clean, Level=2, SmoothNakedEdges=0)  # -> flatten(OutputMeshCurves)

# ----
wbinnerpolygons = WeaverbirdsInnerPolygonsSubdivision(MeshCurves=wbloop, Level=1)  # disabled
merge = Merge(Data1=wbloop, Data2=clean_2)
result = Mesh(merge)
result_2 = ClusterOutput(result)

# ==== cluster DefineGoals
printlines = ClusterInput()
wbedges = ClusterInput()
gate = StreamGate(Printlines=printlines, Gate=0)  # -> Target0, Target1
wbedges_2 = Line(wbedges)
dispatch = Dispatch(List=wbedges_2, DispatchPattern=gate.Target0)  # -> ListA, ListB
join = JoinCurves(Curves=simplify(dispatch.ListA), Preserve=False)
explode = Explode(Curve=join, Recursive=True)  # -> Segments, Vertices
int = ClusterInput()
pt = ClusterInput()
number_slider = Slider(7, range=0..10)

# ---- group: knots
int_2 = Integer(int)
pt_2 = Point(pt)
flatten = FlattenTree(Tree=explode.Segments, Path="{0}")
curvepoint = PointOnCurve(flatten, parameter=0.5)
cps = ClosestPoints(Point=pt_2, Cloud=curvepoint, Count=int_2)  # -> ClosestPoint, CPIndex, Distance
item = ListItem(List=flatten, Index=cps.CPIndex, Wrap=True)
line = Line(item)
lng = ListLength(List=line)
series = Series(Start=0, Step=1, Count=expr("x-1", lng))
line_2 = Line(line)
shift = ShiftList(List=line, Shift=series, Wrap=True)
angle = Angle(LineA=line_2, LineB=shift, Strength=number_slider)
length_line = LengthLine(Line=line_2, Strength=number_slider)

# ----
number_slider_2 = Slider(10, range=0..10)

# ---- group: segments
cls = Closed(Curve=join)  # -> Closed, Periodic
line_3 = Line(explode.Segments)
shift_2 = ShiftList(List=simplify(line_3), Shift=1, Wrap=simplify(cls.Closed))
line_4 = Line(line_3)
short = ShortestList(ListA=line_4, ListB=shift_2, TrimMode=2)  # -> ListA, ListB
angle_2 = Angle(LineA=short.ListA, LineB=short.ListB, Strength=number_slider_2)
length_line_2 = LengthLine(Line=line_4, Strength=number_slider_2)

# ----
B = ClusterInput()
mesh = ClusterInput()

mesh_2 = Mesh(mesh)
smooth = Smooth(M=mesh_2, Strength=Slider(2, range=0..10))
show = Show(G=mesh_2)

# ---- group: textile
flip = FlipMatrix(Data=gate.Target0)
cset = CreateSet(List=flip)  # -> Set, Map
lng_2 = ListLength(List=cset.Set)
larger = LargerThan(FirstNumber=lng_2, SecondNumber=1)  # -> flatten(LargerThan), OrEqualTo
dispatch_2 = Dispatch(List=wbedges_2, DispatchPattern=larger.LargerThan)  # -> ListA, flatten(ListB)
line_5 = Line(dispatch_2.ListB)
len = Length(Curve=line_5)

# ----
multiplication = Multiplication(A=len, B=B)

# ---- group: textile (continued)
length_line_3 = LengthLine(Line=line_5, Length=multiplication, Strength=Slider(1, range=1..10))

# ----
goal_objects = Merge(Data1=length_line_2, Data2=angle_2, Data3=length_line, Data4=angle, Data5=length_line_3, Data6=show, Data7=smooth)  # -> flatten(Result)
clean = CleanTree(RemoveNulls=True, RemoveInvalid=True, RemoveEmpty=False, Tree=goal_objects)
T = ClusterOutput(clean)

# ==== cluster Output
O = ClusterInput()
layer = Panel("C:\Users\ronny\Desktop\Rhino\output\")
group = Group(Objects=O)
layer_2 = Panel("Simulation")
N = ClusterInput()
layer_3 = DefineLayer(Name=N)
join = TextJoin(Text=[layer_2, layer_3], Join="::")
in_run = ClusterInput()
attributes = DefineObjectAttributes(Layer=join)
layer_4 = Panel("Mesh")
B = ClusterInput()
panel = Panel(O)
bake = BakeObjects(Geometry=group, Attributes=attributes, Bake=B)
c_script = CSharpScript(in_run=in_run, in_mesh=O, in_name=N, in_path=layer)  # -> out, A; inputs in_run: Boolean, in_mesh: list of Mesh, in_name: String, in_path: String
# ---------- c_script: C# ----------
    
    /* gefunden unter: https://discourse.mcneel.com/t/how-to-write-selected-mesh-to-an-obj-file/47365/6 */
  
  if(in_run) {
      path = System.IO.Path.GetDirectoryName(in_path) + "\\" + in_name + ".obj";
      int faceCount = 0;
      using(StreamWriter writer = new StreamWriter(path)) {
        for(int n = 0; n < in_mesh.Count; n++) {
          List<String> vert = new List<String>();
          List<String> face = new List<String>();

          in_mesh[n].Faces.ConvertQuadsToTriangles();
          BoundingBox bbox = in_mesh[n].GetBoundingBox(true);

          for(int i = 0; i < in_mesh[n].Vertices.Count; i++) {
            vert.Add(String.Format("v {0} {1} {2}", -in_mesh[n].Vertices[i].X, in_mesh[n].Vertices[i].Z, in_mesh[n].Vertices[i].Y));
          }

          for(int i = 0; i < in_mesh[n].TextureCoordinates.Count; i++) {
            double tx = in_mesh[n].TextureCoordinates[i].X;
            double ty = in_mesh[n].TextureCoordinates[i].Y;
            vert.Add(String.Format("vt " + tx.ToString("F6") + " " + ty.ToString("F6")));
          }

          for(int i = 0; i < in_mesh[n].Normals.Count; i++) {
            vert.Add(String.Format("vn {0} {1} {2}", -in_mesh[n].Normals[i].X, in_mesh[n].Normals[i].Z, in_mesh[n].Normals[i].Y));
          }

          for(int i = 0; i < in_mesh[n].Faces.Count; i++) {
            MeshFace f = in_mesh[n].Faces.GetFace(i);
            int fa = f.A + 1 + faceCount;
            int fb = f.B + 1 + faceCount;
            int fc = f.C + 1 + faceCount;
            string fas = fa.ToString();
            string fbs = fb.ToString();
            string fcs = fc.ToString();
            face.Add(String.Format("f " + fas + "/" + fas + "/" + fas + " " + fbs + "/" + fbs + "/" + fbs + " " + fcs + "/" + fcs + "/" + fcs));
          }

          for(int i = 0; i < vert.Count; i++) {
            writer.WriteLine(vert[i]);
          }

          writer.WriteLine("");
          writer.WriteLine("g " + in_name + n.ToString());

          for(int i = 0; i < face.Count; i++) {
            writer.WriteLine(face[i]);
          }
          faceCount += in_mesh[n].Vertices.Count;
        }
      }
    }
    A = path;
# ---------- c_script: C# additional code ----------
  String path;
# ---------- end c_script ----------
save = ObjectSave(
    BakeToggle=in_run,
    FileDirectory=layer,
    FileName=N,
    GeometryObjects=O,
    Layer=layer_2,
    ObjectName=layer_4,
    ObjectColor=RGB(255, 255, 255),
    LayerColor=RGB(255, 255, 255))  # disabled

# ==== cluster Select
number_slider = Slider(7, range=0..10)
multiplication = Multiplication(A=number_slider, B=2)
Z = UnitZ(Factor=1)
vec = VectorXYZ(XComponent=multiplication, YComponent=multiplication, ZComponent=0)  # -> Vector, Length
number_slider_2 = Slider(3, range=0..10)
circle = CircleCNR(Center=Z, Normal=Z, Radius=number_slider)
Z_2 = UnitZ(Factor=0)
rec_2pt = Rectangle2Pt(Plane=PlaneXY(0, 0, 0), PointA=Point(0, 0, 0), PointB=vec.Vector, Radius=0)  # -> Rectangle, Length
ln = Line(StartPoint=Z_2, EndPoint=vec.Vector)
multiplication_2 = Multiplication(A=number_slider_2, B=2)
arrpolar = PolarArray(Geometry=ln, Plane=PlaneXY(0, 0, 0), Count=multiplication_2, Angle=6.283185307)  # -> Geometry, Transform
arrrec = RectangularArray(Geometry=circle, Cell=rec_2pt.Rectangle, XCount=3, YCount=3)  # -> Geometry, Transform
division = Division(A=1, B=number_slider_2)
join = JoinCurves(Curves=arrpolar.Geometry, Preserve=False)
end = EndPoints(Curve=join)  # -> Start, End
multiplication_3 = Multiplication(A=division, B=3.141592654)
ln_2 = Line(StartPoint=Z_2, EndPoint=Z)
ln_3 = Line(StartPoint=end.Start, EndPoint=end.End)
layer = ClusterInput()
example = ClusterInput()
nr = ClusterInput()
rotax = RotateAxis(Geometry=ln_3, Angle=multiplication_3, Axis=ln_2)  # -> Geometry, Transform
layer_2 = DefineLayer(Layer=layer)
join_2 = JoinCurves(Curves=[join, ln_3, rotax.Geometry], Preserve=False)
expression = Expression(Nr=nr, Example=example, Expression="If(Example, Nr, false)")
expression_2 = Expression(Layer=layer_2, Example=example, Expression="If(Example, 0, Layer)")
origami = Curve([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])
pattern = Curve([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])
rectangle = Curve(rec_2pt.Rectangle)
circle_2 = Curve(circle)
star = Curve(join_2)
grp = Group(Objects=rectangle)
grp_2 = Group(Objects=star)
grp_3 = Group(Objects=pattern)
grp_4 = Group(Objects=origami)
grp_5 = Group(Objects=circle_2)
merge = Merge(Data1=flatten(grp_5), Data2=flatten(grp), Data3=flatten(grp_2), Data4=flatten(grp_3), Data5=flatten(grp_4))
reflay = ReferenceByLayer(LayerName=expression_2)
dispatch = Dispatch(List=merge, DispatchPattern=expression)  # -> Example, ListB
filtertype = FilterByType(Geometry=reflay, ObjectType="Curve")
clean = CleanTree(RemoveNulls=True, RemoveInvalid=True, RemoveEmpty=False, Tree=filtertype)
ungroup = Ungroup(Group=dispatch.Example)
crv = Curve(flatten([clean, ungroup]))
crv_2 = ClusterOutput(crv)

# ==== cluster Center
crv = ClusterInput()
crv_2 = Curve(crv)
cpoly = ControlPolygon(Curve=crv_2)  # -> Polygon, Points
pcen = PolygonCenter(Polyline=cpoly.Polygon)  # -> CenterV, CenterE, CenterA
ma = MassAddition(Input=pcen.CenterV)  # -> Result, PartialResults
lng = ListLength(List=pcen.CenterV)
division = Division(A=ma.Result, B=lng)
gruppenmittelpunkt = Point(division)
center = Point(Point(0, 0, 0))
vec2pt = Vector2Pt(PointA=gruppenmittelpunkt, PointB=center, Unitize=False)  # -> Vector, Length
move = Move(Geometry=crv_2, Motion=vec2pt.Vector)  # -> Geometry, Transform
C = ClusterOutput(move.Geometry)

# ==== cluster Steps
num = ClusterInput()
num_2 = Number(num)
expression = Expression(x=num_2, Expression="If(x>20, 20, x)")
stepper = ClusterInput()
expression_2 = Expression(x=expression, Stepper=stepper, Expression="If(Stepper, x, 1000)")
iterations = ClusterOutput(expression_2)

# ==== cluster AddImperfection
M = ClusterInput()
cullvertices = MeshCullUnusedVertices(Mesh=M)
demesh = DeconstructMesh(Mesh=cullvertices)  # -> Vertices, Faces, Colours, Normals
null = NullItem(Item=demesh.Vertices)  # -> NullFlags, InvalidFlags, Description
not = GateNot(A=null.InvalidFlags)
cull = CullPattern(List=demesh.Vertices, CullPattern=not)
pdecon = Deconstruct(Point=cull)  # -> XComponent, YComponent, ZComponent
lng = ListLength(List=pdecon.ZComponent)
random = Random(Range=Domain(0, 0.001), Number=lng, Seed=2)
pt = ConstructPoint(XCoordinate=pdecon.XComponent, YCoordinate=pdecon.YComponent, ZCoordinate=random)
conmesh = ConstructMesh(Vertices=pt, Faces=demesh.Faces)
M_2 = ClusterOutput(conmesh)
