# Grasshopper definition 170625_meshedit_2_template_.gh (Grasshopper 0.9.76)
# plug-ins: MeshEdit Components

number_slider = Slider(1, range=0..1)
element = Slider(0, range=0..100)
pt = ConstructPoint(XCoordinate=number_slider, YCoordinate=number_slider, ZCoordinate=0)
box = DomainBox(Base=PlaneXY(0, 0, 0), X=number_slider, Y=number_slider, Z=number_slider)
arrbox = BoxArray(Geometry=pt, Cell=box, XCount=Slider(31, range=0..100), YCount=Slider(5, range=0..100), ZCount=Slider(8, range=0..100))  # -> simplify(Geometry), Transform
pop3d = Populate3D(
    Region={Plane=PlaneXY(0, 0, 0), X=Domain(0, 10), Y=Domain(0, 10), Z=Domain(0, 2)},
    Count=Slider(100, range=0..5000),
    Seed=1)  # -> flatten(Population)
mbox = MeshBox(Base={Plane=PlaneXY(0, 0, 0), X=Domain(-10, 10), Y=Domain(-10, 10), Z=Domain(-10, 10)}, XCount=10, YCount=10, ZCount=10)
dam = DataDam(DataA=pop3d, BufferDelay=10000000, BufferMode=0)
weldvertices = MeshWeldVertices(Mesh=mbox, Tolerance=0.01)  # -> RuntimeMessage, Mesh
pt_2 = Point(flatten(dam))
demesh = DeconstructMesh(Mesh=weldvertices.Mesh)  # -> Vertices, Faces, Colours, Normals
bbox = BoundingBox(Content=pt_2, Plane=PlaneXY(0, 0, 0), UnionBox=True)  # -> Box, Box_2
del3dcell = _3DDelaunayCell(Points=pt_2, PlanktonMesh=False)  # -> _3DDelaunayCells, CellIndices; disabled
hullpt = ConvexHullPoints(Points=pt_2, _3D=True)  # -> ConvexHull, Indices
convexhull = _3DConvexHull(Points=pt_2, Plankton=False, PlanktonMesh=False)
_3dvoro = _3DVoronoi(Points=pt_2, Boundingbox=bbox.Box, Plankton=False, PlanktonMesh=False, weld=False, WeldMesh=False)  # -> _3DVoronoiCells, Connectivity
del3d = _3DDelaunay(Points=pt_2)  # -> TopologicalEdges, Connectivity
format = Format(Format="{0};{1}", Culture=1033, Data0=Slider(0, range=0..100), Data1=element)
branch = TreeBranch(Tree=_3dvoro.Connectivity, Path=format, MaintainPaths=True)
branch_2 = TreeBranch(Tree=_3dvoro._3DVoronoiCells, Path=format, MaintainPaths=True)
branch_3 = TreeBranch(Tree=del3dcell.CellIndices, Path=format, MaintainPaths=True)  # disabled
branch_4 = TreeBranch(Tree=del3d.Connectivity, Path=format, MaintainPaths=True)
item = ListItem(List=pt_2, Index=branch_4, Wrap=True)
item_2 = ListItem(List=pt_2, Index=element, Wrap=True)
item_3 = ListItem(List=pt_2, Index=branch_3, Wrap=True)  # disabled
item_4 = ListItem(List=pt_2, Index=branch, Wrap=True)
crv = Curve(del3d.TopologicalEdges)  # disabled
mesh = Mesh(del3dcell._3DDelaunayCells)
crv_2 = Curve(branch_2)
ln = Line(StartPoint=item, EndPoint=item_2)
